# Grasshopper definition a-a-a-morph_atlas_multi_image.gh (Grasshopper 1.0.7)
# plug-ins: Pufferfish, Human, Moonlight

rectangle = Rectangle(Plane=PlaneXY(0, 0, 0), XSize="-.5 to .5", YSize="-.5 to .5", Radius=0)  # -> Rectangle, Length
explode = Explode(Curve=rectangle.Rectangle, Recursive=True)  # -> Segments, Vertices
panel = Panel("""1
0""")
cull = CullPattern(List=explode.Segments, CullPattern=invert(panel))
item = ListItem(List=cull, Index=0, Wrap=True)
flip = FlipCurve(Curve=cull, Guide=item)  # -> Curve, Flag
replace = ReplaceItems(List=flip.Curve, Item=item, Wrap=False)  # -> reverse(List)
number_slider = Slider(3, range=0..10)
loft = Loft(Curves=replace, Options={Adjust=False, Closed=False, LoftEnds=0, LoftSimp=0, LoftType=0, Rebuild=10, Refit=0.01})
srf = Surface(reparameterize(loft))

panel_2 = Panel("0 to -1")
division = Division(A="1", B=2)
division_2 = Division(A="1.6", B=2)
panel_3 = Panel("""0
0.1
0.4
0.7
1""")
neg = Negative(Value=division)
neg_2 = Negative(Value=division_2)
dom = ConstructDomain(DomainStart=neg, DomainEnd=division)
dom_2 = ConstructDomain(DomainStart=neg_2, DomainEnd=division_2)
range = Range(Domain=Domain(0, 1), Steps=expr("x-1", Slider(4, range=0..10)))
rectangle_2 = Rectangle(Plane=PlaneXY(0, 0, 0), XSize=dom, YSize=dom_2, Radius=0)  # -> Rectangle, Length
boundary = BoundarySurfaces(Edges=rectangle_2.Rectangle)  # -> reparameterize(Surfaces)
pt = ConstructPoint(XCoordinate=range, YCoordinate=panel_3, ZCoordinate=0)
pt_2 = ConstructPoint(XCoordinate="0.5", YCoordinate="0.3", ZCoordinate=0)
xz = XZPlane(Origin=Point(0, 0, 0))
rec = Rectangle({Plane=PlaneXY(0, 0.16, 0), Size=Domain2(u=-0.5..0.5, v=-0.48..0.48)})
rec_2 = Rectangle({Plane=PlaneXY(0, 0.14, 0), Size=Domain2(u=-0.5..0.5, v=-0.5..0.5)})
mirror = Mirror(Geometry=boundary, Plane=xz)  # -> Geometry, Transform
flippsrf = FlipPolysurface()  # -> Flipped, R
boundary_2 = BoundarySurfaces(Edges=rec)  # -> reparameterize(Surfaces)
boundary_3 = BoundarySurfaces(Edges=rec_2)  # -> reparameterize(Surfaces)
evalsrf = EvaluateSurface(Surface=boundary, Point=pt_2)  # -> Point, Normal, UDirection, VDirection, Frame
iso = IsoCurve(Surface=mirror.Geometry, UVPoint=pt)  # -> UIsocurve, VIsocurve
pt_3 = Point(Point(-0.5, -0.3701700419, 0))
divide = DivideDomain²(Domain=srf, UCount=number_slider, VCount=number_slider)
preview = CustomPreview(Geometry=[iso.UIsocurve, iso.VIsocurve], Material=ColourSwatch(SwatchColor=RGB(255, 0, 0)))
divide_2 = DivideDomain²(Domain=srf, UCount=Slider(2, range=0..10), VCount=Slider(8, range=0..10))
rev = Reverse(Vector=evalsrf.Point)
subsrf = Isotrim(Surface=boundary_2, Domain=divide)
subsrf_2 = Isotrim(Surface=boundary_3, Domain=divide)
subsrf_3 = Isotrim(Surface=srf, Domain=divide)
srf_2 = Surface(srf)
scale = Scale(Geometry=boundary_3, Center=pt_3, Factor=Slider(3, range=0..10))  # -> Geometry, Transform
smesh = SimpleMesh(Brep=subsrf)
smesh_2 = SimpleMesh(Brep=subsrf_2)
tri = Triangulate(Mesh=smesh)  # -> Mesh, Count
tri_2 = Triangulate(Mesh=smesh_2)  # -> Mesh, Count
surfacemap = SurfaceMapping(Mesh=tri_2.Mesh, Surface=boundary_3)
surfacemap_2 = SurfaceMapping(Mesh=tri_2.Mesh, Surface=scale.Geometry)
Y = UnitY(Factor=Slider(0.18, range=-1..1))
move = Move(Geometry=srf_2, Motion=Y)  # -> Geometry, Transform
area = Area(Geometry=surfacemap)  # -> Area, Centroid
scale_2 = Scale(Geometry=surfacemap, Center=area.Centroid, Factor=Slider(0.8, range=0..1))  # -> Geometry, Transform
moonlight = Moonlight(Mode=Toggle(False))
mjoin = MeshJoin(Meshes=surfacemap)  # -> flatten(Mesh)
mjoin_2 = MeshJoin(Meshes=surfacemap_2)  # -> flatten(Mesh)
panel_4 = Panel("C:\cWeb\projects\a-a-a\.system\atlas\")
mjoin_3 = MeshJoin(Meshes=scale_2.Geometry)  # -> flatten(Mesh)
crv = Curve(<curve referenced from the Rhino model>)
division_3 = Division(A="1.6", B=2)
multiplication = Multiplication(A="1.6", B="0.1")
eval = EvaluateCurve(Curve=crv, Parameter=Slider(0.5, range=0..1))  # -> Point, Tangent, Angle
scale_nu = ScaleNU(Geometry=tri.Mesh, Plane=eval.Point, ScaleX=1, ScaleY=Slider(0.9, range=0..1), ScaleZ=1)  # -> Geometry, Transform
surfacemap_3 = SurfaceMapping(Mesh=scale_nu.Geometry, Surface=move.Geometry)
mjoin_4 = MeshJoin(Meshes=surfacemap_3)  # -> flatten(Mesh)
merge = Merge(Data1=mjoin_4, Data2=mjoin_3, Data3=mjoin_2, Data4=mjoin, Data5=mjoin_3)
pdecon = Deconstruct(Point=eval.Point)  # -> XComponent, YComponent, ZComponent
subtraction = Subtraction(A=division_3, B=multiplication)
dir = DirectoryContents(FolderPath=panel_4, Filter="*", IncludeSubfolders=False)  # -> FilePaths, FileNames
demesh = DeconstructMesh(Mesh=merge)  # -> flatten(Vertices), Faces, Colours, Normals
concat = Concatenate(FragmentA=panel_4, FragmentB=dir.FileNames, FragmentC=".jpg")
pt_4 = ConstructPoint(XCoordinate=0, YCoordinate=subtraction, ZCoordinate=0)
neg_3 = Negative(Value=pdecon.YComponent)
bbox = BoundingBox(Content=merge, Plane=PlaneXY(0, 0, 0), UnionBox=True)  # -> Box, Box_2
pdecon_2 = Deconstruct(Point=demesh.Vertices)  # -> XComponent, YComponent, ZComponent
devec = DeconstructVector(Vector=pt_4)  # -> XComponent, YComponent, ZComponent
debox = DeconstructBox(Box=bbox.Box)  # -> Plane, X, Y, Z
sort = SortList(Keys=pdecon_2.YComponent)  # -> Keys, ValuesA
Y_2 = UnitY(Factor=devec.YComponent)
number_slider_2 = Slider(0, range=0..3)
item_2 = ListItem(List=sort.Keys, Index="-1", Wrap=True)
addition = Addition(A=item_2, B="0.5")
dedomain = DeconstructDomain(Domain=debox.X)  # -> Start, End
move_2 = Move(Geometry=merge, Motion=Y_2)  # -> Geometry, Transform
Y_3 = UnitY(Factor=neg_3)
abs = Absolute(Value=[dedomain.Start, dedomain.End])
ma = MassAddition(Input=abs)  # -> Result, PartialResults
item_3 = ListItem(List=move_2.Geometry, Index=number_slider_2, Wrap=True)
item_4 = ListItem(List=concat, Index=number_slider_2, Wrap=True)
move_3 = Move(Geometry=merge, Motion=Y_3)  # -> Geometry, Transform
division_4 = Division(A="1", B=ma.Result)
scale_3 = Scale(Geometry=merge, Center=Point(0, 0, 0), Factor=division_4)  # -> Geometry, Transform
previewmat = CustomPreviewMaterials(Geometry=item_3, DiffuseColor=RGB(255, 255, 255), DiffuseBitmap=item_4)
mesh = Mesh(move_3.Geometry)
de_code_mesh = DeCodeMesh(m=mesh)  # -> F, V, C, N, UVs; inputs m: Mesh
# ---------- de_code_mesh: Python ----------
"""Extract Mesh UV coordinates
    Inputs:
        m: Mesh to extract UV coordinates from
    Output:
        F: List of faces
        V: List of vertices
        C: List of vertex colors, if they exist
        N: List of face normals, if they exist
        UVs: List of texture coordinates (UVs), if they exist"""

__author__ = "Nathan"
__version__ = "2018.07.20"

import rhinoscriptsyntax as rs

if not m==None:
    F = m.Faces
    V = m.Vertices
    N = m.FaceNormals
    C = m.VertexColors
    UVs = m.TextureCoordinates
# ---------- end de_code_mesh ----------
demesh_2 = DeconstructMesh(Mesh=mesh)  # -> Vertices, Faces, Colours, Normals
tstat = TreeStatistics(Tree=de_code_mesh.F)  # -> Paths, Length, Count
item_5 = ListItem(List=tstat.Paths, Index=0, Wrap=True)
num = Number("5")
branch = TreeBranch(Tree=de_code_mesh.F, Path=item_5, MaintainPaths=True)
round_point = RoundPoint(data=demesh_2.Normals, data_2=num)
num_2 = Number("7")
pdecon_3 = Deconstruct(Point=round_point)  # -> XComponent, YComponent, ZComponent
facetoarr = FaceToArr(T=branch)
tstat_2 = TreeStatistics(Tree=de_code_mesh.F)  # -> Paths, Length, Count
round_point_2 = RoundPoint(data=de_code_mesh.V, data_2=num_2)

panel_5 = Panel("C:\cWeb\projects\a-a-a\.system\images\")
lng = ListLength(List=subsrf_3)
series = Series(Start=Slider(14, range=0..30), Step=1, Count=lng)
dir_2 = DirectoryContents(FolderPath=panel_5, Filter="*", IncludeSubfolders=False)  # -> FilePaths, FileNames
item_6 = ListItem(List=dir_2.FileNames, Index=series, Wrap=True)
concat_2 = Concatenate(FragmentA=panel_5, FragmentB=item_6, FragmentC=".jpg")

series_2 = Series(Start=0, Step=1, Count=tstat_2.Count)
pdecon_4 = Deconstruct(Point=round_point_2)  # -> XComponent, YComponent, ZComponent
pdecon_5 = Deconstruct(Point=de_code_mesh.UVs)  # -> XComponent, YComponent, ZComponent
concat_3 = Concatenate(
    FragmentA=pdecon_4.XComponent,
    FragmentB=",",
    FragmentC=pdecon_4.YComponent,
    FragmentD=",",
    FragmentE=pdecon_4.ZComponent,
    FragmentF=",")
concat_4 = Concatenate(FragmentA=pdecon_5.XComponent, FragmentB=",", FragmentC=pdecon_5.YComponent, FragmentD=",")
concat_5 = Concatenate(
    FragmentA=pdecon_3.XComponent,
    FragmentB=",",
    FragmentC=pdecon_3.ZComponent,
    FragmentD=",",
    FragmentE=pdecon_3.YComponent,
    FragmentF=",")
join = TextJoin(Text=facetoarr)
join_2 = TextJoin(Text=concat_3)
join_3 = TextJoin(Text=concat_4)
join_4 = TextJoin(Text=concat_5)
concat_6 = Concatenate(FragmentA="position", FragmentB="_", FragmentC=series_2, FragmentD=":")  # -> graft(Result)
concat_7 = Concatenate(FragmentA="uv", FragmentB="_", FragmentC=series_2, FragmentD=":")  # -> graft(Result)
concat_8 = Concatenate(FragmentA="normal", FragmentB="_", FragmentC=series_2, FragmentD=":")  # -> graft(Result)
brec = BoundingRectangle(Geometry=flatten(srf_2), Plane=PlaneXY(0, 0, 0), Axis=0, Slide=0, Union=True)  # -> Bounding, DimensionX, DimensionY
concat_9 = Concatenate(FragmentA="indices:new Uint16Array(", FragmentB="[", FragmentC=join, FragmentD="]),")
concat_10 = Concatenate(FragmentA=concat_6, FragmentB="[", FragmentC=join_2, FragmentD="],")
concat_11 = Concatenate(FragmentA=concat_7, FragmentB="[", FragmentC=join_3, FragmentD="],")
concat_12 = Concatenate(FragmentA=concat_8, FragmentB="[", FragmentC=join_4, FragmentD="],")
panel_6 = Panel("2048")
gate = StreamGate(Stream=concat_12, Gate=0)  # -> Target0, Target1

# ---- group: ATLAS
previewmat_2 = CustomPreviewMaterials(Geometry=graft(subsrf_3), DiffuseColor=RGB(255, 255, 255), DiffuseBitmap=graft(concat_2))

# ----
concat_13 = Concatenate(FragmentB=concat_10, FragmentC=concat_11, FragmentJ=gate.Target0)
division_5 = Division(A="4096", B=brec.DimensionX)
join_5 = TextJoin(Text=flatten(concat_9))  # -> simplify(Result)
join_6 = TextJoin(Text=flatten(concat_13))  # -> simplify(Result)
geo = Geometry(brec.Bounding)
concat_14 = Concatenate(FragmentC="export const morphData ={", FragmentA=join_5, FragmentB=join_6, FragmentD="}")
save = Button()
wrtietext = WrtieText(filePath="C:\cWeb\projects\a-a-a\src\data\morph_data.ts", data=concat_14, activate=Toggle(True))  # -> out, A; inputs data: list
# ---------- wrtietext: VB ----------
    If activate Then

      Dim i As Integer
      Dim aryText(4) As String

      aryText(0) = "Mary WriteLine"
      aryText(1) = "Had"
      aryText(2) = "Another"
      aryText(3) = "Little"
      aryText(4) = "One"

      ' the data is appended to the file. If file doesnt exist, a new file is created
      Dim objWriter As New System.IO.StreamWriter(filePath, append)

      For i = 0 To data.Count - 1
        objWriter.WriteLine(data(i))
      Next

      objWriter.Close()

    End If

    If clearFile Then
      Dim objWriter As New System.IO.StreamWriter(filePath, False)
      objWriter.Close()
    End If
# ---------- end wrtietext ----------

# ---- group: to save png double click clock to reset + set rhino viewport to top
clock = Clock(SecondHand=True)

# ----
moonlight_2 = Moonlight(Mode=Toggle(True))
python = GhPythonScript(frame=geo, factor=division_5, path="C:\cWeb\projects\a-a-a\.system\atlas\", filename="atlas_2", save=save)  # -> out; inputs frame: Polyline, save: Boolean
# ---------- python: Python ----------
import Rhino.Geometry as rg
import Rhino.Display as rd
import scriptcontext as sc
import System, operator

# Get x and y coordinates of frame vertices
px, py = set(frame.X), set(frame.Y)

# Get horizontal and vertical lengths
dx = abs(reduce(operator.sub, px))
dy = abs(reduce(operator.sub, py))

# Construct the points that will set the print area
offx = (dx/dy) * (3/factor)
offy = (dy/dx )* (3/factor)
p1 = rg.Point3d(min(px) + offx, min(py) + offy, 0)
p2 = rg.Point3d(max(px) - offx, max(py) - offy, 0)

# Set resolution to chosen scaling factor
sx, sy = dx*factor, dy*factor


def Capture():

    view = sc.doc.Views.ActiveView
    size = System.Drawing.Size(sx, sy) 

    settings = rd.ViewCaptureSettings(view, size, 300) #view, size, dpi
    settings.SetWindowRect(p1, p2)
    settings.RasterMode = True
    settings.DrawGrid = False
    settings.DrawAxis = False
    settings.DrawWallpaper = False

    bitmap = rd.ViewCapture.CaptureToBitmap(settings)
    bitmap.Save(path+filename+".jpg")


if save:
    Capture()
# ---------- end python ----------
output_path = Panel(python)
calendar = Calendar()
cdate = CombineDateTime(Date=calendar, Time=clock)
ddate = DeconstructDate(Date=cdate)  # -> Year, Month, Day, Hour, Minute, Second
concat_15 = Concatenate(
    FragmentA=ddate.Month,
    FragmentB="_",
    FragmentC=ddate.Day,
    FragmentD="_",
    FragmentE=ddate.Hour,
    FragmentG="_",
    FragmentF=ddate.Minute)

# ==== cluster RoundPoint
data = ClusterInput()
data_2 = ClusterInput()
data_3 = Data(data)
pdecon = Deconstruct(Point=data_3)  # -> XComponent, YComponent, ZComponent
data_4 = Data(data_2)
roundd = RoundToDecimalPlace(NumberX=pdecon.XComponent, DecimalPlace=data_4, RoundType=0)  # -> Rounded, Difference
roundd_2 = RoundToDecimalPlace(NumberX=pdecon.YComponent, DecimalPlace=data_4, RoundType=0)  # -> Rounded, Difference
roundd_3 = RoundToDecimalPlace(NumberX=pdecon.ZComponent, DecimalPlace=data_4, RoundType=0)  # -> Rounded, Difference
pt = ConstructPoint(XCoordinate=roundd.Rounded, YCoordinate=roundd_2.Rounded, ZCoordinate=roundd_3.Rounded)
pt_2 = ClusterOutput(pt)

# ==== cluster FaceToArr
T = ClusterInput()
rep = ReplaceText(Text=T, Find="T", RecursiveReplace=False)
rep_2 = ReplaceText(Text=rep, Find="{", RecursiveReplace=False)
rep_3 = ReplaceText(Text=rep_2, Find=";", Replace=",", RecursiveReplace=False)
rep_4 = ReplaceText(Text=rep_3, Find="}", Replace=",", RecursiveReplace=False)
R = ClusterOutput(rep_4)
